# Dynamo graph SierpinskiTriangleV2.dyn (Dynamo 2.16.2.5624)

# group: Size
integer_slider = IntegerSlider(4, range=3..6 step 1)

# group: Sierpinski triangle 1
python_script = Python(IN[0]=integer_slider)  # IronPython2
# ---------- python_script.python (85 lines) ----------
### Sierpinski triangle 1

import sys
import clr
clr.AddReference('ProtoGeometry')
from Autodesk.DesignScript.Geometry import *
import math

def apply_rules(input_string, rules):
    result = []
    for symbol in input_string:
        if symbol in rules:
            result.append(rules[symbol])
        else:
            result.append(symbol)
    return ''.join(result)

def generate_l_system(axiom, rules, iterations):
    current_string = axiom
    l_system = []
    for i in range(iterations):
        current_string = apply_rules(current_string, rules)
        l_system.append(current_string)
    return l_system

variables = "FG"
constants = "LR"
axiom = "FRFRF"
rules = {
    "F": "FRGLFLGRF", 
    "G" : "GG"
}

iterations = IN[0]
side_length = 20 

#Create my l system
l_system = generate_l_system(axiom, rules, iterations)
# Only use the final iteration of the L-system
row = l_system[-1]  # Get the final iteration

#Now make it into Dynamo lines
Lines = []
StartPoint = Point.ByCoordinates(0, 0, 0)  # Start from origin
Vx = 0
Vy = 1
vector = Vector.ByCoordinates(Vx, Vy, 0)  # Initial vector direction


for letter in row:
	if letter == "F": 
		Line = Line.ByStartPointDirectionLength(StartPoint, vector, side_length)
		Lines.append(Line)	
		StartPoint = Line.EndPoint	
	elif letter == "G": 
		Line = Line.ByStartPointDirectionLength(StartPoint, vector, side_length)
		#Lines.append(Line)	
		StartPoint = Line.EndPoint		
	elif letter == "L":	#Rotate 120 degrees left	
		vector = vector.Rotate( Vector.ZAxis(), -120)		
	elif letter == "R":	#Rotate 120 degrees right	
		vector = vector.Rotate( Vector.ZAxis(), 120)


# Second Corner (along the X-axis)
def sequence_value(n):
    return 40 * (2 ** (n - 1))
    
side_length = sequence_value(iterations)

corner2 = Point.ByCoordinates(0, side_length, 0)
corner3 = Point.ByCoordinates(-(math.sqrt(3) / 2) * side_length , side_length/2 , 0)

# Centre point calculation using centroid formula
# Apex of the tetrahedron
apex_z = (math.sqrt(2.0/3.0) * side_length)  # Height of a regular tetrahedron
corner4 = Point.ByCoordinates(-(math.sqrt(3) / 6) * side_length, side_length / 2, apex_z)

# Calculate the centroid of the tetrahedron
centroid_x = (StartPoint.X + corner2.X + corner3.X + corner4.X) / 4
centroid_y = (StartPoint.Y + corner2.Y + corner3.Y + corner4.Y) / 4
centroid_z = (StartPoint.Z + corner2.Z + corner3.Z + corner4.Z) / 4
CentrePoint = Point.ByCoordinates(centroid_x, centroid_y, centroid_z)

OUT = Lines, StartPoint, corner2, corner3, CentrePoint, CentrePoint.Z
# ----------------------------------------
code_block = CodeBlock(i=python_script) { i[0]; }

# group: Get planes of sides
code_block_2 = CodeBlock(i=python_script) { [i[1], i[2], i[3]]; }
code_block_3 = CodeBlock { true; }
byPoints = PolyCurve.ByPoints(points=code_block_2, connectLastToFirst=code_block_3)
curves = PolyCurve.Curves(polyCurve=byPoints)
planeAtParameter = Curve.PlaneAtParameter(curve=curves)

# group: Create a pyramid
code_block_4 = CodeBlock { 70.5; }
rotate = Geometry.Rotate(geometry=code_block@L1, basePlane=planeAtParameter, degrees=code_block_4)
code_block_5 = CodeBlock(a=code_block, b=rotate) { [a , b]; }

code_block_6 = CodeBlock(i=python_script) { i[4]; }
code_block_7 = CodeBlock(i=python_script) { i[5] * 0.7; }

# group: Mapping sphere
byCenterPointRadius = Sphere.ByCenterPointRadius(centerPoint=code_block_6, radius=code_block_7)
explode = Geometry.Explode(geometry=byCenterPointRadius)
code_block_8 = CodeBlock(i=explode) { i[0]; }

# group: make shapes and move
pullOntoSurface = Curve.PullOntoSurface(curve=code_block_5, surface=code_block_8)
flatten = List.Flatten(list=pullOntoSurface)
shuffle = List.Shuffle(list=flatten)
code_block_9 = CodeBlock(centre_point=code_block_6) { centre_point; }
X = Point.X(point=code_block_9)
Y = Point.Y(point=code_block_9)
Z = Point.Z(point=code_block_9)
code_block_10 = CodeBlock(x=X, y=Y, z=Z) { x * -1; y * -1; z * -1; }
translate = Geometry.Translate(geometry=shuffle, xTranslation=code_block_10.out0, yTranslation=code_block_10.out1, zTranslation=code_block_10.out2)

# group: Sphereize the triangles + colour
python_script_2 = Python(IN[0]=translate)  # CPython3
# ---------- python_script_2.python (28 lines) ----------
import random
from clr import AddReference
AddReference('ProtoGeometry')
from Autodesk.DesignScript.Geometry import *
from DSCore import Color

colours = [
    (76, 153, 0),   
    (102, 204, 0),   
    (40, 87, 10),     # Dark Green
    (0, 204, 0),   # Electric Green
    (204, 255, 204)  
]

# Function to convert RGB to Dynamo Color
def rgb_to_dynamo_colour(rgb):
    r, g, b = rgb
    return Color.ByARGB(255, r, g, b)

# Convert colours to Dynamo
dynamo_colours = [rgb_to_dynamo_colour(rgb) for rgb in colours]

lines = IN[0]

# Randomly assign colours to the lines
line_colours = [random.choice(dynamo_colours) for _ in lines]

OUT = line_colours
# ----------------------------------------
byGeometryColor = Modifiers.GeometryColor.ByGeometryColor(geometry=translate, color=python_script_2)

# group: Sierpinski triangle 1
python_script_3 = Python(IN[0]=integer_slider)  # IronPython2
# ---------- python_script_3.python (85 lines) ----------
### Sierpinski triangle 1

import sys
import clr
clr.AddReference('ProtoGeometry')
from Autodesk.DesignScript.Geometry import *
import math

def apply_rules(input_string, rules):
    result = []
    for symbol in input_string:
        if symbol in rules:
            result.append(rules[symbol])
        else:
            result.append(symbol)
    return ''.join(result)

def generate_l_system(axiom, rules, iterations):
    current_string = axiom
    l_system = []
    for i in range(iterations):
        current_string = apply_rules(current_string, rules)
        l_system.append(current_string)
    return l_system

variables = "FG"
constants = "LR"
axiom = "FRFRF"
rules = {
    "F": "FRGLFLGRF", 
    "G" : "GG"
}

iterations = IN[0] -1
side_length = 20 

#Create my l system
l_system = generate_l_system(axiom, rules, iterations)
# Only use the final iteration of the L-system
row = l_system[-1]  # Get the final iteration

#Now make it into Dynamo lines
Lines = []
StartPoint = Point.ByCoordinates(0, 0, 0)  # Start from origin
Vx = 0
Vy = 1
vector = Vector.ByCoordinates(Vx, Vy, 0)  # Initial vector direction


for letter in row:
	if letter == "F": 
		Line = Line.ByStartPointDirectionLength(StartPoint, vector, side_length)
		Lines.append(Line)	
		StartPoint = Line.EndPoint	
	elif letter == "G": 
		Line = Line.ByStartPointDirectionLength(StartPoint, vector, side_length)
		#Lines.append(Line)	
		StartPoint = Line.EndPoint		
	elif letter == "L":	#Rotate 120 degrees left	
		vector = vector.Rotate( Vector.ZAxis(), -120)		
	elif letter == "R":	#Rotate 120 degrees right	
		vector = vector.Rotate( Vector.ZAxis(), 120)


# Second Corner (along the X-axis)
def sequence_value(n):
    return 40 * (2 ** (n - 1))
    
side_length = sequence_value(iterations)

corner2 = Point.ByCoordinates(0, side_length, 0)
corner3 = Point.ByCoordinates(-(math.sqrt(3) / 2) * side_length , side_length/2 , 0)

# Centre point calculation using centroid formula
# Apex of the tetrahedron
apex_z = (math.sqrt(2.0/3.0) * side_length)  # Height of a regular tetrahedron
corner4 = Point.ByCoordinates(-(math.sqrt(3) / 6) * side_length, side_length / 2, apex_z)

# Calculate the centroid of the tetrahedron
centroid_x = (StartPoint.X + corner2.X + corner3.X + corner4.X) / 4
centroid_y = (StartPoint.Y + corner2.Y + corner3.Y + corner4.Y) / 4
centroid_z = (StartPoint.Z + corner2.Z + corner3.Z + corner4.Z) / 4
CentrePoint = Point.ByCoordinates(centroid_x, centroid_y, centroid_z)

OUT = Lines, StartPoint, corner2, corner3, CentrePoint, CentrePoint.Z
# ----------------------------------------
code_block_11 = CodeBlock(i=python_script_3) { i[0]; }

# group: Get planes of sides
code_block_12 = CodeBlock(i=python_script_3) { [i[1], i[2], i[3]]; }
code_block_13 = CodeBlock { true; }
byPoints_2 = PolyCurve.ByPoints(points=code_block_12, connectLastToFirst=code_block_13)
curves_2 = PolyCurve.Curves(polyCurve=byPoints_2)
planeAtParameter_2 = Curve.PlaneAtParameter(curve=curves_2)

# group: Create a pyramid
code_block_14 = CodeBlock { 70.5; }
rotate_2 = Geometry.Rotate(geometry=code_block_11@L1, basePlane=planeAtParameter_2, degrees=code_block_14)
code_block_15 = CodeBlock(a=code_block_11, b=rotate_2) { [a , b]; }

code_block_16 = CodeBlock(i=python_script_3) { i[4]; }
code_block_17 = CodeBlock(i=python_script_3) { i[5] * 0.7; }

# group: Mapping sphere
byCenterPointRadius_2 = Sphere.ByCenterPointRadius(centerPoint=code_block_16, radius=code_block_17)
explode_2 = Geometry.Explode(geometry=byCenterPointRadius_2)
code_block_18 = CodeBlock(i=explode_2) { i[0]; }

# group: make shapes and move
pullOntoSurface_2 = Curve.PullOntoSurface(curve=code_block_15, surface=code_block_18)
flatten_2 = List.Flatten(list=pullOntoSurface_2)
shuffle_2 = List.Shuffle(list=flatten_2)
code_block_19 = CodeBlock(centre_point=code_block_16) { centre_point; }
X_2 = Point.X(point=code_block_19)
Y_2 = Point.Y(point=code_block_19)
Z_2 = Point.Z(point=code_block_19)
code_block_20 = CodeBlock(x=X_2, y=Y_2, z=Z_2) { x * -1; y * -1; z * -1; }
translate_2 = Geometry.Translate(geometry=shuffle_2, xTranslation=code_block_20.out0, yTranslation=code_block_20.out1, zTranslation=code_block_20.out2)

# group: Rotate inner ball... because
origin = Point.Origin()
ZAxis = Vector.ZAxis()
now = DateTime.Now()
components = DateTime.Components(dateTime=now)
code_block_21 = CodeBlock(sec=components.second) { sec * 6; }
rotate_3 = Geometry.Rotate(geometry=translate_2, origin=origin, axis=ZAxis, degrees=code_block_21)
YAxis = Vector.YAxis()
rotate_4 = Geometry.Rotate(geometry=rotate_3, origin=origin, axis=YAxis, degrees=code_block_21)

# group: Sphereize the triangles + colour
python_script_4 = Python(IN[0]=rotate_3)  # CPython3
# ---------- python_script_4.python (28 lines) ----------
import random
from clr import AddReference
AddReference('ProtoGeometry')
from Autodesk.DesignScript.Geometry import *
from DSCore import Color

colours = [
    (255, 255, 0),    
    (255, 128, 0),    
    (153, 0, 0),     
    (204, 0, 0),   
    (255, 0, 0)   
]

# Function to convert RGB to Dynamo Color
def rgb_to_dynamo_colour(rgb):
    r, g, b = rgb
    return Color.ByARGB(255, r, g, b)

# Convert colours to Dynamo
dynamo_colours = [rgb_to_dynamo_colour(rgb) for rgb in colours]

lines = IN[0]

# Randomly assign colours to the lines
line_colours = [random.choice(dynamo_colours) for _ in lines]

OUT = line_colours
# ----------------------------------------
byGeometryColor_2 = Modifiers.GeometryColor.ByGeometryColor(geometry=rotate_3, color=python_script_4)

# group: Colour my inner bauble
translate_3 = Geometry.Translate(geometry=code_block_18, xTranslation=code_block_20.out0, yTranslation=code_block_20.out1, zTranslation=code_block_20.out2)
code_block_22 = CodeBlock { 250; 255; 0; }
byARGB = Color.ByARGB(alpha=code_block_22.out0, red=code_block_22.out1, green=code_block_22.out2, blue=code_block_22.out2)
byGeometryColor_3 = Modifiers.GeometryColor.ByGeometryColor(geometry=translate_3, color=byARGB)

# group: Colour my inner bauble
translate_4 = Geometry.Translate(geometry=code_block_8, xTranslation=code_block_10.out0, yTranslation=code_block_10.out1, zTranslation=code_block_10.out2)
code_block_23 = CodeBlock { 100; 204; 255; 255; }
byARGB_2 = Color.ByARGB(alpha=code_block_23.out0, red=code_block_23.out1, green=code_block_23.out2, blue=code_block_23.out3)
byGeometryColor_4 = Modifiers.GeometryColor.ByGeometryColor(geometry=translate_4, color=byARGB_2)
