# Dynamo graph StarryNight.dyn "Christmas Sparkle Ball" (Dynamo 3.2.1.5366)

# group: UI
# Slide the sliders
how_many_rods = IntegerSlider(200, range=50..200 step 5)
shuffle = IntegerSlider(46, range=0..100 step 1)

# group: Make some random points
code_block = CodeBlock { -50; 50; }
code_block_2 = CodeBlock { 3; 1; 10; }
randomList = Math.RandomList(amount=code_block_2.out0, value1=code_block_2.out1, value2=code_block_2.out2, seed=shuffle)
code_block_3 = CodeBlock(i=randomList) { i[0]; i[1]; i[2]; }
randomList_2 = Math.RandomList(amount=how_many_rods, value1=code_block.out0, value2=code_block.out1, seed=code_block_3.out0)
randomList_3 = Math.RandomList(amount=how_many_rods, value1=code_block.out0, value2=code_block.out1, seed=code_block_3.out1)
randomList_4 = Math.RandomList(amount=how_many_rods, value1=code_block.out0, value2=code_block.out1, seed=code_block_3.out2)
byCoordinates = Point.ByCoordinates(x=randomList_2, y=randomList_3, z=randomList_4)

# group: Base spikes
origin = Point.Origin()
byStartPointEndPoint = Line.ByStartPointEndPoint(startPoint=origin, endPoint=byCoordinates)

# group: Move away from grid
code_block_4 = CodeBlock { 200; }
translate = Geometry.Translate(geometry=byStartPointEndPoint, zTranslation=code_block_4)

# group: Colouring in
color_palette = ColorPalette({R: 0, G: 39, B: 76, A: 255})
byGeometryColor = Modifiers.GeometryColor.ByGeometryColor(geometry=translate, color=color_palette)

# group: Grab some points on the spikes for lights
code_block_5 = CodeBlock { 0..1..#7; }
pointAtParameter = Curve.PointAtParameter(curve=translate, param=code_block_5, lacing=CrossProduct)
flatten = List.Flatten(list=pointAtParameter)
shuffle_2 = List.Shuffle(list=flatten)
count = List.Count(list=shuffle_2)
code_block_6 = CodeBlock(i=count) { i/ 4; }
# note: Added because for some reason List.Chop doesn't like the code block...
# Maybe a weird, hidden rounding thing?
floor = Math.Floor(number=code_block_6)
chop = List.Chop(list=shuffle_2, lengths=floor)

# group: Time
now = DateTime.Now()
components = DateTime.Components(dateTime=now)
code_block_7 = CodeBlock(i=components.second) { i - 1; }
code_block_8 = CodeBlock { 4; }
mod = code_block_7 % code_block_8

# group: Colouring in
getItemAtIndex = List.GetItemAtIndex(list=chop, index=mod)
color_palette_2 = ColorPalette({R: 246, G: 245, B: 97, A: 255})
byGeometryColor_2 = Modifiers.GeometryColor.ByGeometryColor(geometry=getItemAtIndex, color=color_palette_2)

file_path = Filename("No file selected.")
fromPath = FileObject(path=file_path)  # "File.FromPath"
readFromFile = Image.ReadFromFile(file=fromPath)

# group: Background picture
code_block_9 = CodeBlock()
# ---------- code_block_9.designscript (4 lines) ----------
[Point.ByCoordinates(60, -300,  0),
Point.ByCoordinates(60, -300, 400),
Point.ByCoordinates(60, 300, 400),
Point.ByCoordinates(60, 300, 0)];
# ----------------------------------------
byPerimeterPoints = Surface.ByPerimeterPoints(points=code_block_9)
x_samples = DoubleSlider(358, range=0..500 step 0.1)  # graph input
y_samples = DoubleSlider(362.5, range=0..500 step 0.1)  # graph input
pixels = Image.Pixels(image=readFromFile, xSamples=x_samples, ySamples=y_samples)
bySurfaceColors = Modifiers.GeometryColor.BySurfaceColors(surface=byPerimeterPoints, colors=pixels)

# group: "Have yourself a Starry Night this Christmas!" 🌟🎄 Instructions
# note: Go to the URL on the left.
# Save the image to your computer.
# Clickk on the "File Path" node and navigate to the saved image.
# Set run to "Periodic" to get the twinkle.
string = StringInput("https://raw.githubusercontent.com/MoosiestMoose/Christmas2024/refs/heads/main/starryNight.jpg")
